% Simulink data dictionary GlobalDataD_ControllerApplication.sldd

voltSEPICMin = Simulink.Parameter(single(16.8), StorageClass="ExportedGlobal", Min=9, Max=42, Unit="V")  % Minimum voltage output of the SEPIC converter for the provided LED strips
voltSEPICMax = Simulink.Parameter(single(20.4), StorageClass="ExportedGlobal", Min=9, Max=42, Unit="V")  % Maximum voltage output of the SEPIC converter for the provided LED strips
totLEDStrips = Simulink.Parameter(uint8(6), StorageClass="ExportedGlobal", Min=1, Max=10, Unit="1")  % This number indicates the total number of LED strips present in the hardware demo. The standard board has 6 LEDs strips
currLEDMax = Simulink.Parameter(single(1000), StorageClass="ExportedGlobal", Min=0, Max=1000, Unit="mA")  % Maximum current through one LED strip
dcpwmSEPICMax = Simulink.Parameter(single(0.95), StorageClass="ExportedGlobal", Min=0, Max=1, Unit="1")  % Maximum duty cycle for the PWM driving the SEPIC power stage
dcpwmLEDMax = Simulink.Parameter(single(1), StorageClass="ExportedGlobal", Min=0, Max=1, Unit="1")  % Maximum duty cycle for the PWM driving the LEDs
powerPSUMax = Simulink.Parameter(single(18), StorageClass="ExportedGlobal", Min=0, Max=1, Unit="Watt")  % Maximum power allowed by the power supply unit (PSU)