% Simulink data dictionary LocalDataD_Closed_Loop_Control_Voltage.sldd
% references GlobalDataD_ControllerApplication.sldd
% references GlobalDataD_ConfigSettings.sldd

VoltCtrlr_IGain = Simulink.Parameter(single(1.36305535), StorageClass="ExportedGlobal")
VoltCtrlr_PGain = Simulink.Parameter(single(0.00550519256), StorageClass="ExportedGlobal")
VoltCtrlr_dcMax_a = Simulink.Parameter(single(-0.396343887), StorageClass="ExportedGlobal")
VoltCtrlr_dcMax_b = Simulink.Parameter(single(-0.386128694), StorageClass="ExportedGlobal")
VoltCtrlr_dcMax_c = Simulink.Parameter(single(1.01834393), StorageClass="ExportedGlobal")