% Simulink data dictionary LocalDataD_Closed_Loop_LEDControllers.sldd
% references GlobalDataD_ControllerApplication.sldd
% references GlobalDataD_ConfigSettings.sldd

CurrCtrlr_IGain = Simulink.Parameter(single(0.1701), StorageClass="ExportedGlobal")
CurrCtrlr_PGain = Simulink.Parameter(single(8.505e-5), StorageClass="ExportedGlobal")
CurrCtrlr_IC_Table = Simulink.Parameter(single([0.6239 0.342 0.2082 0.1391 0.1003 0.0765 0.0612 0.0502; 0.81 0.81 0.5512 0.3684 0.2655 0.2027 0.1615 0.1331]), StorageClass="ExportedGlobal")
CurrCtrlr_IC_CurrBrkpnt = Simulink.Parameter(single([40 100]), StorageClass="ExportedGlobal")
CurrCtrlr_IC_VoltBrkpnt = Simulink.Parameter(single([17 17.5 18 18.5 19 19.5 20 20.5]), StorageClass="ExportedGlobal")