% Simulink data dictionary LocalDataD_SupervisoryLogic.sldd
% references GlobalDataD_ControllerApplication.sldd
% references GlobalDataD_ConfigSettings.sldd

SEPIC_Efficiency = Simulink.Parameter(single(0.88), StorageClass="ExportedGlobal")
Batt_MaxCoulomb = single(5400)
Batt_Initial_SoC = 0.8
Batt_Em0_LUT = [3.498029; 3.560917; 3.606291; 3.645979; 3.678645; 3.707264; 3.793319; 3.879273; 3.973486; 4.075972; 4.192557]
Batt_nrCellSeries = 3
Batt_SoC_LUT = [0; 0.1; 0.2; 0.3; 0.4; 0.5; 0.6; 0.7; 0.8; 0.9; 1]
Batt_Capacity = 1.5
Batt_R0 = [0.008080079; 0.008457118; 0.008247237; 0.00835374; 0.008427621; 0.007867158; 0.007924051; 0.008000713; 0.008157466; 0.008133719; 0.007952261]
Batt_R1 = [0.003476415; 0.002444041; 0.002603922; 0.00253242; 0.001884584; 0.001861115; 0.002159089; 0.002386107; 0.002370076; 0.00199731; 0.0025585]
Batt_Tau1 = [25.6244; 36.37911; 44.8535; 44.80181; 36.54956; 20.81027; 28.04341; 41.30667; 39.86355; 22.82587; 37.56313]