% Simulink data dictionary LocalDataD_TIC2000_F28069_Interfaces.sldd
% references GlobalDataD_ControllerApplication.sldd

Vfb_SEPIC_LinearCoeff = Simulink.Parameter(single(0.0120108398), StorageClass="ExportedGlobal")
Vfb_SEPIC_Offset = Simulink.Parameter(single(0.965031862), StorageClass="ExportedGlobal")
Ifb_LED_LinearCoeff = Simulink.Parameter(single(0.268554688), StorageClass="ExportedGlobal")
Ifb_LED_Offset1 = Simulink.Parameter(single(7), StorageClass="ExportedGlobal")
Ifb_LED_Offset2 = Simulink.Parameter(single(9), StorageClass="ExportedGlobal")
Ifb_LED_Offset3 = Simulink.Parameter(single(5), StorageClass="ExportedGlobal")
Ifb_LED_Offset4 = Simulink.Parameter(single(1), StorageClass="ExportedGlobal")
Ifb_LED_Offset5 = Simulink.Parameter(single(16), StorageClass="ExportedGlobal")
Ifb_LED_Offset6 = Simulink.Parameter(single(2), StorageClass="ExportedGlobal")
Ifb_SEPIC_LinearCoeff = Simulink.Parameter(single(0.982517123), StorageClass="ExportedGlobal")
Ifb_SEPIC_Offset = Simulink.Parameter(single(77), StorageClass="ExportedGlobal")
Vin_Supply_LinearCoeff = Simulink.Parameter(single(0.0161984321), StorageClass="ExportedGlobal")
timer_period_LED = Simulink.Parameter(int16(4499), StorageClass="ExportedGlobal")
timer_period_LED_phase1 = Simulink.Parameter(int16(0), StorageClass="ExportedGlobal")
timer_period_LED_phase2 = Simulink.Parameter(int16(1500), StorageClass="ExportedGlobal")
timer_period_LED_phase3 = Simulink.Parameter(int16(3000), StorageClass="ExportedGlobal")
timer_period_SEPIC = Simulink.Parameter(int16(899), StorageClass="ExportedGlobal")