% Simulink design studies MultipleSimulation_Panel_OperatingMode_PLCCoder_Harness.mldatx for model OperatingMode_PLCCoder_SignalBuilder

study "SimulateAll": 5 simulations
  combinatorial set (5 points):
    "Block Parameter_1": BlockParameter(BlockPath=OperatingMode_PLCCoder_SignalBuilder/Inputs, Name=ActiveScenario), values Label=TestCase_1, Label=TestCase_2, Label=TestCase_3, Label=TestCase_4, Label=TestCase_5 (5 points)