test file "BaselineAndEquivalence_TestFile"
  coverage: Decision

suite "Functional Scenario Equivalence"
  description: This test suite will go through various functional scenario, and compared them to the saved results from 2024a. This series of tests is only used to verify possible regressions cross releases, model configuration changes and impact on results from refactoring. No requirements are validated.
  cleanup callback:
    sltest_testSuite

  case "IntroductionScenario" [baseline]
    description: This a regression test using the "introduction scenario" which is the deafult scenario when opening the project and model.
    model DCDC_SEPIC_TopLevelModel, mode Normal, start time 0, stop time 10
    input "TopLevel_IntroductionScenario.mat", mapped to UserDefinedValues (active)
    logged signals "Signal Set 1": Sensors, SoftwareOutput
    pre-load callback:
      VoltCL_LEDCL_SimscapeAvg;
    baseline "Baseline_IntroductionScenario.mat": rel tol 0.02, leading tol 0.0001, lagging tol 0.0001
      dcpwmSEPIC: abs tol 0.01, rel tol 0.02, leading tol 0.0001, lagging tol 0.0001
      dcpwmLEDvector: abs tol 0.01, rel tol 0.02, leading tol 0.0001, lagging tol 0.0001
      voltSEPIC: abs tol 0.05, rel tol 0.02, leading tol 0.0001, lagging tol 0.0001
      currSEPIC: abs tol 10, rel tol 0.02, leading tol 0.0001, lagging tol 0.0001
      currLEDstrips: abs tol 5, rel tol 0.02, leading tol 0.0001, lagging tol 0.0001
      voltPSU: abs tol 0.05, rel tol 0.02, leading tol 0.0001, lagging tol 0.0001